# Grasshopper definition routing.gh (Grasshopper 1.0.8)
# plug-ins: Pufferfish, eleFront

radius = Slider(3, range=0..10)
radius_2 = Slider(3, range=0..10)
geo = Geometry(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)
pt = Point([<point referenced from the Rhino model> x24])
pt_2 = Point([<point referenced from the Rhino model> x24])
cluster = Cluster(A=pt_2, B=pt, num=radius, num_2=radius_2, geo=geo, num_3=Slider(-10, range=-10..0))
bouncysolver = BouncySolver(
    GoalObjects=cluster,
    Reset=Button(),
    Threshold=1e-15,
    Tolerance=0.0001,
    Damping=Slider(0.049, range=0..10),
    Iterations=10,
    On=Toggle(True))  # -> I, V, O
dam = DataDam(DataA=bouncysolver.O, BufferDelay=10000000, BufferMode=0)
filtertype = FilterByType(ObjectType="Curve", Geometry=dam, invertFilter=False, returnNulls=False)  # -> ExcludedGeometry, IncludedGeometry
range = Range(Domain=Domain(0, 1), Steps=10)
range_2 = Range(Domain=Domain(0, 1), Steps=Slider(78, range=0..100))
parampipemsh = ParameterPipeMesh(
    Curve=filtertype.IncludedGeometry,
    Radius=Slider(2, range=0..10),
    ParametersU=range_2,
    ParametersV=range,
    Weighted=False,
    Lengths=False,
    Angle=0,
    Rotation=0,
    EndType=1,
    Triangulate=False)
colmm = CollisionManyMany(Colliders=parampipemsh)  # -> Collision, Indices
panel = Panel(colmm.Indices)

# ==== cluster Cluster
num = ClusterInput()
num_2 = ClusterInput()
num_3 = ClusterInput()
geo = ClusterInput()
num_4 = Number(num)
num_5 = Number(num_2)
num_6 = Number(num_3)
geo_2 = Geometry(geo)
A = ClusterInput()
B = ClusterInput()
ln = Line(StartPoint=A, EndPoint=B)
wrap = ShrinkWrap(Geometry=geo_2, Offset=num_6, Smoothing=0, Optimization=10, FillHoles=True)
len = Length(Curve=ln)
division = Division(A=len, B=num_4)
divide = DivideCurve(Curve=ln, Count=division, Kinks=False)  # -> Points, Tangents, Parameters
end = EndPoints(Curve=ln)  # -> Start, End
panel = Panel("""0
-1""")
pline = PolyLine(Vertices=divide.Points, Closed=False)
merge = Merge(Data1=graft(end.Start), Data2=graft(end.End))
cull_i = CullIndex(List=divide.Points, Indices=panel, Wrap=True)
explode = Explode(Curve=pline, Recursive=True)  # -> simplify(Segments), Vertices
meshcp = MeshClosestPoint(Point=merge, Mesh=geo_2)  # -> Point, Index, Parameter
meval = MeshEval(Mesh=geo_2, Parameter=meshcp.Parameter)  # -> Point, flatten(Normal), Colour
item = ListItem(List=explode.Segments, Index=panel, Wrap=True)  # -> flatten(Item)
line = Line(explode.Segments)

# ---- group: Attempts at allwing self intersection of points
# I was trying to make it so that points in the same
# line aren't trying to avoid each other (stretches
# out the line too much) This solution of ignoring
# all pairs of segents in a line is very slow.
index = ItemIndex(List=flatten(line), Item=line)
lng = ListLength(List=line)
dup = DuplicateData(Data=index, Number=lng, Order=True)  # -> simplify(Data)
py3 = Python3Script(tree=line)  # -> out, a; inputs tree: tree of Line; disabled
# ---------- py3: Python ----------
import Rhino
import ghpythonlib.treehelpers as th
import Grasshopper as gh
# type tree = Grasshopper.DataTree
from Grasshopper.Kernel.Data import GH_Path
from Grasshopper import DataTree

from System import Array

import rhinoscriptsyntax as rs


output_list = []
index = 0

new_tree = DataTree[int]()

for top_branch in range(tree.BranchCount):
    for mid_branch in range(tree.Branch(top_branch).Count):
        new_path = GH_Path((index))
        # output_list.append([index for i in range(tree.Branch(top_branch).Count)])
        for i in range(tree.Branch(top_branch).Count):
            new_tree.Add(index, new_path)
        index+=1

output_tree = th.list_to_tree(output_list, source=[0,0,0])

t = DataTree[int]()
t.Add(1, GH_Path([0]))

a = new_tree

print(new_tree)
# ---------- end py3 ----------
partition = PartitionList(List=dup, Size=lng)  # disabled

# ----
rev = Reverse(Vector=meval.Normal)
cull_i_2 = CullIndex(List=line, Indices=panel, Wrap=True)
rod = Rod(Polyline=pline, LengthFactor=1, AngleFactor=1, AxialStrength=10, BendStrength=Slider(3.1, range=0..10))
anchor = Anchor(Point=flatten([end.Start, end.End]), Strength=Slider(46, range=0..100))
collider = Collider(
    Objects=flatten(line),
    Radii=num_5,
    IgnoreA=flatten(py3.a),
    IgnoreB=flatten(partition),
    Strength=Slider(57, range=0..100))
spc = SolidPointCollide(Points=flatten(cull_i), Solid=wrap, Interior=True, Unidirectional=True, Strength=Slider(2674.8, range=0..10000))
direction = Direction(Line=item, Direction=rev, Strength=Slider(100, range=0..100))
ct = ConstantTension(Line=cull_i_2, Strength=Slider(156, range=0..200))
show = Show(G=pline)
merge_2 = Merge(Data1=show, Data2=ct, Data3=collider, Data4=anchor, Data5=spc, Data6=direction, Data7=rod)
R = ClusterOutput(merge_2)
